# Grasshopper definition KetubahBackground.gh (Grasshopper 1.0.7)
# plug-ins: LunchBox

circle = Circle(Plane=PlaneXY(0, 0, 0), Radius=[Slider(100, range=0..100), Slider(14, range=0..100)])
loft = Loft(Curves=circle, Options={Adjust=False, Closed=False, LoftEnds=0, LoftSimp=0, LoftType=0, Rebuild=10, Refit=0.01})
diagrid_structure = DiagridStructure(Surface=loft, UDivisions=Slider(42, range=0..100), VDivisions=Slider(72, range=0..100), Type=True)  # -> StructureLines, StructureNodes
area = Area(Geometry=circle)  # -> Area, Centroid
point = Point(diagrid_structure.StructureNodes)
circle_2 = Circle(Plane=point, Radius=Slider(1.5, range=0..10))
list_item = ListItem(List=area.Centroid, Index=0, Wrap=True)
construct_domain = ConstructDomain(DomainStart=Slider(1.5, range=0..10), DomainEnd=Slider(0.01, range=0..0.01))
distance = Distance(PointA=point, PointB=list_item)
bounds = Bounds(Numbers=distance)
remap_numbers = RemapNumbers(Value=distance, Source=bounds, Target=construct_domain)  # -> Mapped, Clipped
scale = Scale(Geometry=circle_2, Center=point, Factor=remap_numbers.Mapped)  # -> Geometry, Transform
