# Grasshopper definition GrasshopperFile.gh (Grasshopper 1.0.7)

number_slider = Slider(18, range=0..100)
number_slider_2 = Slider(42, range=0..100)
rectangle = Rectangle(Plane=PlaneXY(0, 0, 0), XSize=Slider(4, range=0..100), YSize=number_slider, Radius=0)  # -> Rectangle, Length
subtraction = Subtraction(A=number_slider_2, B=number_slider)
vector_xyz = VectorXYZ(XComponent=Slider(12, range=-15..12), YComponent=subtraction, ZComponent=0)  # -> Vector, Length
circle = Circle(Plane=PlaneXY(0, 0, 0), Radius=number_slider)
vector_xyz_2 = VectorXYZ(XComponent=Slider(-15, range=-15..12), YComponent=0, ZComponent=0)  # -> Vector, Length
move = Move(Geometry=rectangle.Rectangle, Motion=vector_xyz.Vector)  # -> Geometry, Transform
move_2 = Move(Geometry=rectangle.Rectangle, Motion=vector_xyz_2.Vector)  # -> Geometry, Transform
circle_2 = Circle(Plane=PlaneXY(0, 0, 0), Radius=number_slider_2)
move_3 = Move(Geometry=circle, Motion=Vector(0, 0, 10))  # -> Geometry, Transform
polar_array = PolarArray(Geometry=move.Geometry, Plane=PlaneXY(0, 0, 0), Count=Slider(9, range=0..12), Angle=6.283185307)  # -> Geometry, Transform
polar_array_2 = PolarArray(Geometry=move_2.Geometry, Plane=PlaneXY(0, 0, 0), Count=Slider(5, range=-15..12), Angle=6.283185307)  # -> Geometry, Transform
trim_with_regions = TrimWithRegions(Curve=circle_2, Regions=polar_array.Geometry)  # -> Inside, Outside
trim_with_regions_2 = TrimWithRegions(Curve=polar_array.Geometry, Regions=circle_2)  # -> flatten(Inside), Outside
trim_with_regions_3 = TrimWithRegions(Curve=polar_array_2.Geometry, Regions=move_3.Geometry)  # -> Inside, Outside
trim_with_regions_4 = TrimWithRegions(Curve=move_3.Geometry, Regions=polar_array_2.Geometry)  # -> Inside, Outside
join_curves = JoinCurves(Curves=[trim_with_regions_4.Outside, trim_with_regions_3.Inside], Preserve=False)
join_curves_2 = JoinCurves(Curves=[trim_with_regions.Outside, trim_with_regions_2.Inside], Preserve=False)
join_curves_3 = JoinCurves(Curves=[join_curves_2, join_curves], Preserve=False)
